vi "Alamouti_RX_student_OFDM.gvi"   [LabVIEW NXG]
inputs:
  "Modulation Parameters In": T6 = {"Modulation Type"="QPSK", "Control Information\nfor Packet Header/Tail"={"Training Sequence 1 (derived)"=[], "Zero Pad Length"=0, "Training Sequence 2 (derived)"=[]}, "RX Oversample Factor"=20, "Synchronization Options"={"Synchronization Method"="Timing Estimation", "Fixed Offset"=0, "Symbol Timing Recovery Method"="Max Energy", "Frame Detection Method"="Sliding Correlator", "Correct Frequency Offset"=FALSE}, "Number of Data Symbols (Derived)"=250, "RX Sample Rate"=4000000, "Pulse Shaping Parameters"={"Modulation Type"="PSK", "Pulse Shaping Filter"="Raised Cosine", "Filter Parameter"=0.5, "Filter Length (Symbols)"=8}, "Channel Estimation/Equalization Parameters"={"Equalization Method"="Direct", "Channel Estimate Length"=4, "Equalizer Length"=4, "Equalizer Delay"=-1}}
  "Input Complex Symbols 1": c128[]
  "Input Complex Symbols 2": c128[]
  "Channel estimates": T7
  "error in (no error)": error
outputs:
  "Output Complex Symbols": c128[]
  "Modulation Parameters Out": T6
  "error out": error
types:
  T1 = cluster{"Training Sequence 1 (derived)": c128[], "Zero Pad Length": i32, "Training Sequence 2 (derived)": c128[]}
  T2 = cluster{"Synchronization Method": string, "Fixed Offset": i32, "Symbol Timing Recovery Method": string, "Frame Detection Method": string, "Correct Frequency Offset": bool}
  T3 = enum{"none", "Raised Cosine", "Root Raised Cos", "Gaussian"}
  T4 = cluster{"Modulation Type": enum{"FSK", "PSK", "QAM", "MSK", "PAM", "ASK"}, "Pulse Shaping Filter": T3, "Filter Parameter": f64, "Filter Length (Symbols)": i32}
  T5 = cluster{"Equalization Method": string, "Channel Estimate Length": i32, "Equalizer Length": i32, "Equalizer Delay": i32}
  T6 = cluster{"Modulation Type": string, "Control Information\nfor Packet Header/Tail": T1, "RX Oversample Factor": i32, "Synchronization Options": T2, "Number of Data Symbols (Derived)": i32, "RX Sample Rate": f64, "Pulse Shaping Parameters": T4, "Channel Estimation/Equalization Parameters": T5}
  T7 = cluster{"Element 1": c128[], "Element 2": c128[], "Element 3": c128[], "Element 4": c128[]}
diagram:
  Build Array(1+0i, 0.5+0i)
  Array Size(array=$"Input Complex Symbols 1") -> (size(s)=w1)
  Divide(x=w1, y=2) -> w2
  Divide(x=w1, y=64) -> w3
  Reshape Array(inArray=$"Input Complex Symbols 1", size=w3, size=64) -> w4
  for (N = w3) (iteration -> i1) {
    Multiply(2, i1) -> w7
    Array Index(array=w4) -> (out0[w7, _]=w8)
    Multiply(2, i1) -> w9
    Increment(x=w9) -> w10
    Array Index(array=w4) -> (out0[w10, _]=w11)
    append w8 to w5
    append w11 to w6
  }
  # R1[k],R5[k]
  # R2[k], R6[k]
  Reshape Array(inArray=w6, size=w2) -> w12
  # R0[k],R4[k]
  Complex Conjugate(x + iy=w12) -> w13
  Property Node(instance in=$"Channel estimates") -> ("Element 1"=w14, "Element 2"=w15, "Element 3"=w16, "Element 4"=w17)
  call "Complex FFT.gvi"(x=w15, shift?=FALSE, FFT size=64) -> (FFT {x}=w18)
  Array Size(array=w13) -> (size(s)=w19)
  Divide(x=w19, y=64) -> w20
  call "Repeat.gvi"(Array=w18, Numeric=w20) -> (output array=w21)
  Multiply(w21, w13) -> w22
  Array Size(array=$"Input Complex Symbols 2") -> (size(s)=w23)
  Divide(x=w23, y=2) -> w24
  Divide(x=w23, y=64) -> w25
  Reshape Array(inArray=$"Input Complex Symbols 2", size=w25, size=64) -> w26
  for (N = w25) (iteration -> i2) {
    Multiply(2, i2) -> w29
    Array Index(array=w26) -> (out0[w29, _]=w30)
    Multiply(2, i2) -> w31
    Increment(x=w31) -> w32
    Array Index(array=w26) -> (out0[w32, _]=w33)
    append w33 to w27
    append w30 to w28
  }
  Reshape Array(inArray=w28, size=w24) -> w34
  call "Complex FFT.gvi"(x=w16, shift?=FALSE, FFT size=64) -> (FFT {x}=w35)
  # H1[k]*
  # H2[k]*
  Complex Conjugate(x + iy=w35) -> w36
  Array Size(array=w34) -> (size(s)=w37)
  Divide(x=w37, y=64) -> w38
  call "Repeat.gvi"(Array=w36, Numeric=w38) -> (output array=w39)
  Multiply(w39, w34) -> w40
  Reshape Array(inArray=w5, size=w2) -> w41
  call "Complex FFT.gvi"(x=w14, shift?=FALSE, FFT size=64) -> (FFT {x}=w42)
  # Ho[k]*
  Complex Conjugate(x + iy=w42) -> w43
  Array Size(array=w41) -> (size(s)=w44)
  Divide(x=w44, y=64) -> w45
  call "Repeat.gvi"(Array=w43, Numeric=w45) -> (output array=w46)
  # (R0[k] R4[k])H0*[k]
  Multiply(w46, w41) -> w47
  # R3[k],R7[k]
  Reshape Array(inArray=w27, size=w24) -> w48
  Complex Conjugate(x + iy=w48) -> w49
  call "Complex FFT.gvi"(x=w17, shift?=FALSE, FFT size=64) -> (FFT {x}=w50)
  Array Size(array=w49) -> (size(s)=w51)
  Divide(x=w51, y=64) -> w52
  call "Repeat.gvi"(Array=w50, Numeric=w52) -> (output array=w53)
  # (R3*[k] R7*[k])H3[k]
  Multiply(w53, w49) -> w54
  # ~s0,~s2,~s4
  # (R1*[k] R5*[k])H1[k]
  # (R2[k] R6[k])H2*[k]
  Add(w47, w22, w40, w54) -> w55
  Array Size(array=w13) -> (size(s)=w56)
  Divide(x=w56, y=64) -> w57
  call "Repeat.gvi"(Array=w42, Numeric=w57) -> (output array=w58)
  Multiply(w58, w13, -1+0i) -> w59
  # H3[k]*
  Complex Conjugate(x + iy=w50) -> w60
  Array Size(array=w34) -> (size(s)=w61)
  Divide(x=w61, y=64) -> w62
  call "Repeat.gvi"(Array=w60, Numeric=w62) -> (output array=w63)
  Multiply(w63, w34) -> w64
  Array Size(array=w49) -> (size(s)=w65)
  Divide(x=w65, y=64) -> w66
  call "Repeat.gvi"(Array=w35, Numeric=w66) -> (output array=w67)
  Multiply(w67, w49, -1+0i) -> w68
  Complex Conjugate(x + iy=w18) -> w69
  Array Size(array=w41) -> (size(s)=w70)
  Divide(x=w70, y=64) -> w71
  call "Repeat.gvi"(Array=w69, Numeric=w71) -> (output array=w72)
  Multiply(w72, w41) -> w73
  # (R0[k] R4[k])H1*[k]
  # -(R1*[k] R5*[k])H0[k]
  # (R2[k] R6[k])H3*[k]
  # -(R3*[k] R7*[k])H2[k]
  Add(w73, w59, w64, w68) -> w74
  # ~s1,~s3,~s5
  Interleave Array(w55, w74) -> w75
  # a0[k]
  Absolute Value(x=w42) -> w76
  Square(x=w76) -> w77
  # a1[k]
  Absolute Value(x=w18) -> w78
  Square(x=w78) -> w79
  Absolute Value(x=w35) -> w80
  # a2[k]
  Square(x=w80) -> w81
  Absolute Value(x=w50) -> w82
  # a3[k]
  Square(x=w82) -> w83
  Add(w77, w79, w81, w83) -> w84
  Interleave Array(w84, w84) -> w85
  Array Size(array=w75) -> (size(s)=w86)
  Divide(x=w86, y=64) -> w87
  call "Repeat.gvi"(Array=w85, Numeric=w87) -> (output array=w88)
  Divide(x=w75, y=w88) -> w89
  $"Output Complex Symbols" <- w89
  $"error out" <- $"error in (no error)"
  $"Modulation Parameters Out" <- $"Modulation Parameters In"
